# Grasshopper definition test.ghx (Grasshopper 1.0.7)

pt = Point(<point referenced from the Rhino model>)
series = Series(Start=0, Step=Slider(5000, range=0..10000), Count=Slider(10, range=0..10))
Z = UnitZ(Factor=series)
move = Move(Geometry=pt, Motion=Z)  # -> Geometry, Transform
pt_2 = Point(move.Geometry)
